# Grasshopper definition export_Agents.gh (Grasshopper 0.9.66)
# plug-ins: LunchBox

srf = Surface(<surface referenced from the Rhino model>)
quads = QuadPanels(Surface=srf, UDivisions=Slider(1, range=0..10), VDivisions=Slider(2, range=0..10))
pt = Point([<point referenced from the Rhino model> x5000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])
debrep = DeconstructBrep(Brep=quads)  # -> Faces, Edges, Vertices
pdecon = Deconstruct(Point=debrep.Vertices)  # -> XComponent, YComponent, ZComponent
pdecon_2 = Deconstruct(Point=pt)  # -> XComponent, YComponent, ZComponent
concat = Concatenate(FragmentA=pdecon.XComponent, FragmentB=" ")
concat_2 = Concatenate(FragmentA=pdecon_2.XComponent, FragmentB=" ")
concat_3 = Concatenate(FragmentA=pdecon.YComponent, FragmentB=" ")
concat_4 = Concatenate(FragmentA=pdecon_2.YComponent, FragmentB=" ")
panel = Panel(concat)
panel_2 = Panel(concat_2)
concat_5 = Concatenate(FragmentA=concat, FragmentB=concat_3)
concat_6 = Concatenate(FragmentA=concat_2, FragmentB=concat_4)
concat_7 = Concatenate(FragmentA=concat_5, FragmentB=pdecon.ZComponent)
concat_8 = Concatenate(FragmentA=concat_6, FragmentB=pdecon_2.ZComponent)
panel_3 = Panel(concat_8)
panel_4 = Panel(concat_5)
panel_5 = Panel(concat_6)
panel_6 = Panel(concat_7)
